# Grasshopper definition capgen.gh (Grasshopper 1.0.4)
# plug-ins: Python Interpreter

mesh = Mesh(<mesh referenced from the Rhino model>)
bbox = BoundingBox(Content=mesh, Plane=PlaneXY(0, 0, 0))  # -> Box, Box_2
Z = UnitZ(Factor=Slider(0.8, range=0.5..1))
boxprop = BoxProperties(Box=bbox.Box)  # -> Center, Diagonal, Area, Volume, Degeneracy
multiplication = Multiplication(A=boxprop.Diagonal, B=0.5)
subtraction = Subtraction(A=boxprop.Center, B=multiplication)
addition = Addition(A=boxprop.Center, B=multiplication)
subtraction_2 = Subtraction(A=addition, B=Z)
addition_2 = Addition(A=subtraction, B=Z)
xy = XYPlane(Origin=subtraction_2)
xy_2 = XYPlane(Origin=addition_2)
Z_2 = UnitZ(Factor=Slider(12, range=0.5..12))
sec = MeshPlane(Mesh=mesh, Plane=xy)
sec_2 = MeshPlane(Mesh=mesh, Plane=xy_2)
msplit = MeshSplitPlane(Mesh=mesh, Plane=xy)  # -> Above, Below
bbox_2 = BoundingBox(Content=sec, Plane=PlaneXY(0, 0, 0), UnionBox=True)  # -> Box, Box_2
bbox_3 = BoundingBox(Content=sec_2, Plane=PlaneXY(0, 0, 0), UnionBox=True)  # -> Box, Box_2
msplit_2 = MeshSplitPlane(Mesh=msplit.Below, Plane=xy_2)  # -> Above, Below
edges = BrepEdges(Brep=bbox_2.Box)  # -> Naked, Interior, NonManifold
boxprop_2 = BoxProperties(Box=bbox_2.Box)  # -> Center, Diagonal, Area, Volume, Degeneracy
neg = Negative(Value=Z_2)
boxprop_3 = BoxProperties(Box=bbox_3.Box)  # -> Center, Diagonal, Area, Volume, Degeneracy
move = Move(Motion=Z_2)  # -> Geometry, Transform
join = JoinCurves(Curves=edges.Naked, Preserve=False)
offset = Offset(Curve=join, Distance=4, Plane=PlaneXY(0, 0, 0), Corners=2)
dim = Dimensions(Surface=offset)  # -> UDimension, VDimension
division = Division(A=dim.UDimension, B=25.4)
python = PythonScript(x=division)  # -> out, a
# ---------- python: Python ----------
__author__ = "dcellucci"

import rhinoscriptsyntax as rs

a = int(x)+1

if a%2 == 0:
	a = a+2
else:
	a = a+1
# ---------- end python ----------
cir = Circle(Plane=PlaneXY(0, 0, 0), Radius=3)
arrrec = RectangularArray(Geometry=cir, Cell={Plane=PlaneXY(0, 0, 0), Size=Domain2(u=0..25.4, v=0..25.4)}, XCount=python.a, YCount=python.a)  # -> Geometry, Transform
python_2 = PythonScript(x=python.a, y=cir)  # -> out, a
# ---------- python_2: Python ----------
__author__ = "dcellucci"

import rhinoscriptsyntax as rs

a = []
latticepitch = 25.4
for i in range(x):
	jrange = [0,x-1]
	if i == 0 or i == x-1:
		jrange = range(x)
	for j in jrange:
		t = rs.VectorCreate([i*latticepitch,j*latticepitch,0],[0,0,0])
		a.append(rs.CopyObject(y,t))
# ---------- end python_2 ----------
bbox_4 = BoundingBox(Content=python_2.a, Plane=PlaneXY(0, 0, 0), UnionBox=True)  # -> Box, Box_2
boxprop_4 = BoxProperties(Box=bbox_4.Box)  # -> Center, Diagonal, Area, Volume, Degeneracy
subtraction_3 = Subtraction(A=boxprop_3.Center, B=boxprop_4.Center)
subtraction_4 = Subtraction(A=boxprop_2.Center, B=boxprop_4.Center)
edges_2 = BrepEdges(Brep=bbox_4.Box)  # -> Naked, Interior, NonManifold
join_2 = JoinCurves(Curves=edges_2.Naked, Preserve=False)
offset_2 = Offset(Curve=join_2, Distance=Slider(6, range=0.5..12), Plane=PlaneXY(0, 0, 0), Corners=2)
merge = Merge(Data1=python_2.a, Data2=offset_2)  # -> flatten(Result)
move_2 = Move(Geometry=merge, Motion=subtraction_3)  # -> Geometry, Transform
move_3 = Move(Geometry=move_2.Geometry, Motion=neg)  # -> Geometry, Transform
boundary = BoundarySurfaces(Edges=move_3.Geometry)
move_4 = Move(Geometry=merge, Motion=subtraction_4)  # -> Geometry, Transform
merge_2 = Merge(Data1=move_2.Geometry, Data2=sec_2)  # -> flatten(Result)
extr = Extrude(Base=move_2.Geometry, Direction=neg)
merge_3 = Merge(Data1=move_4.Geometry, Data2=sec)
boundary_2 = BoundarySurfaces(Edges=merge_2)
boundary_3 = BoundarySurfaces(Edges=flatten(merge_3))
move_5 = Move(Geometry=move_4.Geometry, Motion=Z_2)  # -> Geometry, Transform
merge_4 = Merge(Data1=extr, Data2=boundary_2, Data3=boundary)  # -> flatten(Result)
extr_2 = Extrude(Base=move_4.Geometry, Direction=Z_2)
join_3 = BrepJoin(Breps=merge_4)  # -> Breps, Closed
boundary_4 = BoundarySurfaces(Edges=flatten(move_5.Geometry))
mesh_2 = MeshBrep(
    Brep=join_3.Breps,
    Settings={GridMaxCount=0, GridMinCount=32, JaggedSeams=False, MaxEdgeLength=0, MinEdgeLength=0.0001, MinTolerance=0, Refine=True, RefineAngle=0, RelativeTolerance=0.65, SimplePlanes=True, Tolerance=0})
merge_5 = Merge(Data1=boundary_4, Data2=extr_2, Data3=boundary_3)  # -> flatten(Result)
join_4 = BrepJoin(Breps=merge_5)  # -> Breps, Closed
mesh_3 = MeshBrep(
    Brep=join_4.Breps,
    Settings={GridMaxCount=0, GridMinCount=128, JaggedSeams=False, MaxEdgeLength=0, MinEdgeLength=0.0001, MinTolerance=0, Refine=True, RefineAngle=0, RelativeTolerance=0.65, SimplePlanes=True, Tolerance=0})
merge_6 = Merge(Data1=mesh_3, Data2=mesh_2, Data3=msplit_2.Above)  # -> flatten(Result)
mjoin = MeshJoin(Meshes=merge_6)
bbox_5 = BoundingBox(Content=mjoin, Plane=PlaneXY(0, 0, 0))  # -> Box, Box_2
boxprop_5 = BoxProperties(Box=bbox_5.Box)  # -> Center, Diagonal, Area, Volume, Degeneracy
division_2 = Division(A=boxprop_5.Diagonal, B=25.4)
